# Dynamo graph master_script.dyn (Dynamo 3.2.1.5366)

file_path = Filename("C:\Users\f2021\Downloads\New folder (1)-20240810T142406Z-001\New folder (1)\quantity-estimator-main (2)\revit script\revit data.dyn")
file_path_2 = Filename("C:\Users\f2021\Downloads\New folder (1)-20240810T142406Z-001\New folder (1)\quantity-estimator-main (2)\revit script\material takeoff.dyn")
python_script = Python(IN[0]=file_path, IN[1]=file_path_2)  # CPython3
# ---------- python_script.python (31 lines) ----------
import clr
clr.AddReference('ProtoGeometry')
from Autodesk.DesignScript.Geometry import *
clr.AddReference("DSCoreNodes")
import DSCore
from DSCore import *

# Import system libraries
import sys
import subprocess

# DynamoPlayer path (adjust based on your installation)
dynamo_player_path = r"C:\Program Files\Dynamo\Dynamo Core\2\DynamoPlayer\DynamoPlayer.exe"

# Function to run a Dynamo script
def run_script(script_path):
    command = f'"{dynamo_player_path}" -o "{script_path}"'
    process = subprocess.Popen(command, shell=True)
    process.wait()
    return process.returncode

# Get the list of scripts from input
script_paths = IN[0]

# Execute each script in the list
results = []
for path in script_paths:
    result = run_script(path)
    results.append(result)

OUT = results
# ----------------------------------------
